# Grasshopper definition DeconstructDetail.gh (Grasshopper 1.0.8)

curve = Curve(<curve referenced from the Rhino model>)  # disabled
curve_2 = Curve(<curve referenced from the Rhino model>)
explode = Explode(Curve=curve, Recursive=True)  # -> Segments, Vertices; disabled
construct_point = ConstructPoint(XCoordinate="-120.490", YCoordinate="34.521", ZCoordinate="-4.084")
construct_point_2 = ConstructPoint(XCoordinate="91.728", YCoordinate="-53.383", ZCoordinate="161.976")
curve_closest_point = CurveClosestPoint(Point=explode.Vertices, Curve=curve_2)  # -> Point, Parameter, Distance; disabled
subtraction = Subtraction(A=curve_closest_point.Point, B=explode.Vertices)  # disabled
guid = Guid(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)
vector_display = VectorDisplay(Anchor=curve_closest_point.Point, Vector=subtraction)  # disabled
c_script = CSharpScript(view=guid)  # -> out, a, b, width, height; inputs view: Guid
# ---------- c_script: C# ----------
// Grasshopper Script Instance
#region Usings
using System;
using System.Linq;
using System.Collections;
using System.Collections.Generic;
using System.Drawing;

using Rhino;
using Rhino.Geometry;
using Rhino.DocObjects;

using Grasshopper;
using Grasshopper.Kernel;
using Grasshopper.Kernel.Data;
using Grasshopper.Kernel.Types;
#endregion

public class Script_Instance : GH_ScriptInstance
{
    #region Notes
    /* 
      Members:
        RhinoDoc RhinoDocument
        GH_Document GrasshopperDocument
        IGH_Component Component
        int Iteration

      Methods (Virtual & overridable):
        Print(string text)
        Print(string format, params object[] args)
        Reflect(object obj)
        Reflect(object obj, string method_name)
    */
    #endregion

    private void RunScript(
		Guid view,
		ref object a,
		ref object b,
		ref object width,
		ref object height)
    {
        //Guid newView = view;

        RhinoObject detailGeo = RhinoDocument.Objects.Find(view);

        DetailViewObject details = detailGeo as DetailViewObject;

        Rhino.Display.RhinoViewport vp = details.Viewport;

        Point3d camTarget = vp.CameraTarget;
        Point3d camLoca = vp.CameraLocation;
        var dims = vp.Size;

        double Dwidth = dims.Width;
        double Dheight = dims.Height;

        

        a = camTarget;
        b = camLoca;

        width = Dwidth;
        height = Dheight;


        


    }
}
# ---------- end c_script ----------
merge = Merge(Data1=c_script.a, Data2=c_script.b)
curve_closest_point_2 = CurveClosestPoint(Point=merge, Curve=curve_2)  # -> Point, Parameter, Distance
polyline = PolyLine(Vertices=merge, Closed=False)  # disabled
move = Move(Geometry=curve_closest_point.Point, Motion=subtraction)  # -> Geometry, Transform; disabled
subtraction_2 = Subtraction(A=curve_closest_point_2.Point, B=merge)
deconstruct_vector = DeconstructVector(Vector=subtraction_2)  # -> XComponent, YComponent, ZComponent
panel = Panel(c_script.a)
panel_2 = Panel(c_script.b)
panel_3 = Panel(c_script.width)
panel_4 = Panel(c_script.height)
polyline_2 = PolyLine(Vertices=move.Geometry, Closed=False)  # disabled
absolute = Absolute(Value=deconstruct_vector.ZComponent)
vector_xyz = VectorXYZ(XComponent=deconstruct_vector.XComponent, YComponent=deconstruct_vector.YComponent, ZComponent=absolute)  # -> Vector, Length
vector_display_2 = VectorDisplay(Anchor=curve_closest_point_2.Point, Vector=vector_xyz.Vector)  # disabled
addition = Addition(A=curve_closest_point_2.Point, B=vector_xyz.Vector)
guid_2 = Guid(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)
polyline_3 = PolyLine(Vertices=addition, Closed=False)
list_item = ListItem(List=addition, Index=0, Wrap=True)
c_script_2 = CSharpScript(view=guid_2)  # -> out, a, b, width, height, scale; inputs view: Guid
# ---------- c_script_2: C# ----------
// Grasshopper Script Instance
#region Usings
using System;
using System.Linq;
using System.Collections;
using System.Collections.Generic;
using System.Drawing;

using Rhino;
using Rhino.Geometry;
using Rhino.DocObjects;

using Grasshopper;
using Grasshopper.Kernel;
using Grasshopper.Kernel.Data;
using Grasshopper.Kernel.Types;
#endregion

public class Script_Instance : GH_ScriptInstance
{
    #region Notes
    /* 
      Members:
        RhinoDoc RhinoDocument
        GH_Document GrasshopperDocument
        IGH_Component Component
        int Iteration

      Methods (Virtual & overridable):
        Print(string text)
        Print(string format, params object[] args)
        Reflect(object obj)
        Reflect(object obj, string method_name)
    */
    #endregion

    private void RunScript(
		Guid view,
		ref object a,
		ref object b,
		ref object width,
		ref object height,
		ref object scale)
    {
        //Guid newView = view;

        RhinoObject detailGeo = RhinoDocument.Objects.Find(view);


        DetailViewObject details = detailGeo as DetailViewObject;

        Rhino.Display.RhinoViewport vp = details.Viewport;

        Point3d camTarget = vp.CameraTarget;
        Point3d camLoca = vp.CameraLocation;
        var dims = vp.Size;

        double Dwidth = dims.Width;
        double Dheight = dims.Height;

        DetailView detailView = details.DetailGeometry;

        double scaleFactor = detailView.PageToModelRatio;

        scale = scaleFactor;

        

        a = camTarget;
        b = camLoca;

        width = Dwidth;
        height = Dheight;


        


    }
}
# ---------- end c_script_2 ----------
list_item_2 = ListItem(List=addition, Index="1", Wrap=True)
panel_5 = Panel(c_script_2.scale)
c_script_3 = CSharpScript(view=guid_2, cameraLocation=list_item_2, cameraTarget=list_item)  # -> out, a; inputs view: Guid, cameraLocation: Point3d, cameraTarget: Point3d
# ---------- c_script_3: C# ----------
// Grasshopper Script Instance
#region Usings
using System;
using System.Linq;
using System.Collections;
using System.Collections.Generic;
using System.Drawing;

using Rhino;
using Rhino.Geometry;
using Rhino.DocObjects;

using Grasshopper;
using Grasshopper.Kernel;
using Grasshopper.Kernel.Data;
using Grasshopper.Kernel.Types;
#endregion

public class Script_Instance : GH_ScriptInstance
{
    #region Notes
    /* 
      Members:
        RhinoDoc RhinoDocument
        GH_Document GrasshopperDocument
        IGH_Component Component
        int Iteration

      Methods (Virtual & overridable):
        Print(string text)
        Print(string format, params object[] args)
        Reflect(object obj)
        Reflect(object obj, string method_name)
    */
    #endregion

    private void RunScript(
		Guid view,
		Point3d cameraLocation,
		Point3d cameraTarget,
		ref object a)
    {
        RhinoObject detailGeo = RhinoDocument.Objects.Find(view);
        DetailViewObject details = detailGeo as DetailViewObject;

        if (details==null)
        {
            return;
        }

        Rhino.Display.RhinoViewport vp = details.Viewport;

        //vp.SetCameraLocation(cameraLocation,true);
        //vp.SetCameraTarget(cameraTarget,true);

        vp.SetCameraLocations(cameraTarget,cameraLocation);


        details.CommitViewportChanges();
        detailGeo.CommitChanges();
        RhinoDocument.Views.Redraw();

    }
}
# ---------- end c_script_3 ----------
panel_6 = Panel(list_item_2)
panel_7 = Panel(list_item)
panel_8 = Panel(c_script_2.b)
panel_9 = Panel(c_script_2.a)
