# Grasshopper definition ExpVectorSmooth.gh (Grasshopper 1.0.8)

curve = Curve(<curve referenced from the Rhino model>)
surface = Surface(<surface referenced from the Rhino model>)
curve_2 = Curve(<curve referenced from the Rhino model>)
series = Series(Start=0, Step=Slider(2, range=0..10), Count=Slider(11, range=0..100))
divide_surface = DivideSurface(Surface=surface, UCount=Slider(11, range=0..100), VCount=Slider(23, range=0..100))  # -> Points, Normals, Parameters
offset_curve_loose = OffsetCurveLoose(Curve=curve, Distance=series)
panel = Panel("""0
1""")
offset_curve = OffsetCurve(Curve=curve, Distance=series, Corners=2)  # -> flatten(Curve); disabled
clean_tree = CleanTree(RemoveNulls=True, RemoveInvalid=True, RemoveEmpty=False, Tree=divide_surface.Points)
sift_pattern = SiftPattern(SiftPattern=[0, 0, 1, 1])  # -> Output0, Output1
curve_3 = Curve(<curve referenced from the Rhino model>)
explode = Explode(Curve=offset_curve_loose, Recursive=True)  # -> Segments, Vertices
cull_pattern = CullPattern(List=offset_curve_loose, CullPattern=panel)
cull_pattern_2 = CullPattern(List=offset_curve_loose, CullPattern=invert(panel))
unit_z = UnitZ(Factor=1)
area = Area(Geometry=curve_3)  # -> Area, Centroid
curve_closest_point = CurveClosestPoint(Point=clean_tree, Curve=curve_2)  # -> Point, Parameter, Distance
move = Move(Geometry=cull_pattern, Motion=unit_z)  # -> Geometry, Transform
xy_plane = XYPlane(Origin=area.Centroid)
vector_xyz = VectorXYZ(XComponent=0, YComponent="1", ZComponent=0)  # -> Vector, Length
evaluate_curve = EvaluateCurve(Curve=curve_2, Parameter=curve_closest_point.Parameter)  # -> Point, Tangent, Angle
weave = Weave(Pattern=[0, 1], Stream0=cull_pattern_2, Stream1=move.Geometry, NullGaps=False)
c_script = CSharpScript(V=evaluate_curve.Tangent, alpha=Slider(0.97, range=0..1))  # -> out, S; inputs V: list of Vector3d, alpha: Double
# ---------- c_script: C# ----------
// Grasshopper Script Instance
#region Usings
using System;
using System.Linq;
using System.Collections;
using System.Collections.Generic;
using System.Drawing;

using Rhino;
using Rhino.Geometry;

using Grasshopper;
using Grasshopper.Kernel;
using Grasshopper.Kernel.Data;
using Grasshopper.Kernel.Types;
#endregion

public class Script_Instance : GH_ScriptInstance
{
    #region Notes
    /* 
      Members:
        RhinoDoc RhinoDocument
        GH_Document GrasshopperDocument
        IGH_Component Component
        int Iteration

      Methods (Virtual & overridable):
        Print(string text)
        Print(string format, params object[] args)
        Reflect(object obj)
        Reflect(object obj, string method_name)
    */
    #endregion

    private void RunScript(List<Vector3d> V, double alpha, ref object S)
    {
        if (V == null || V.Count == 0) { S = V; return; }
        var sm = new List<Vector3d>(V.Count);
        Vector3d prev = V[0];
        sm.Add(prev);
        for (int i = 1; i < V.Count; i++)
        {
            Vector3d s = alpha * V[i] + (1.0 - alpha) * prev;
            prev = s;
            sm.Add(s);
        }

        // optional: zero-phase (reduce lag) by smoothing backward once
        prev = sm[sm.Count - 1];
        for (int i = sm.Count - 2; i >= 0; i--)
        {
            Vector3d s = alpha * sm[i] + (1.0 - alpha) * prev;
            sm[i] = s;
            prev = s;
        }

        // optional: keep as directions
        for (int i = 0; i < sm.Count; i++) sm[i].Unitize();
        S = sm;
    }
}
# ---------- end c_script ----------
loft = Loft(Curves=weave, Options={Adjust=False, Closed=False, LoftEnds=0, LoftSimp=0, LoftType=0, Rebuild=10, Refit=0.01})
orient_direction = OrientDirection(Geometry=curve_3, PointA=area.Centroid, DirectionA=vector_xyz.Vector, PointB=clean_tree, DirectionB=c_script.S)  # -> Geometry, Transform
vector_display = VectorDisplay(Anchor=clean_tree, Vector=c_script.S)
custom_preview = CustomPreview(
    Geometry=loft,
    Material={diffuse=RGB(221, 160, 221), emission=RGB(66, 48, 66), shine=0.5, specular=RGB(255, 255, 255), transparency=0})
