# Grasshopper definition CC_Design_Template.gh (Grasshopper 1.0.8)

c_script = CSharpScript()  # -> out, a, b, c
# ---------- c_script: C# ----------
// Grasshopper Script Instance
#region Usings
using System;
using System.Linq;
using System.Collections;
using System.Collections.Generic;
using System.Drawing;

using Rhino;
using Rhino.Geometry;

using Grasshopper;
using Grasshopper.Kernel;
using Grasshopper.Kernel.Data;
using Grasshopper.Kernel.Types;
#endregion

public class Script_Instance : GH_ScriptInstance
{
    #region Notes
    /* 
      Members:
        RhinoDoc RhinoDocument
        GH_Document GrasshopperDocument
        IGH_Component Component
        int Iteration

      Methods (Virtual & overridable):
        Print(string text)
        Print(string format, params object[] args)
        Reflect(object obj)
        Reflect(object obj, string method_name)
    */
    #endregion

    private void RunScript(ref object a, ref object b, ref object c)
    {
        RhinoDoc rhinodoc = RhinoDoc.ActiveDoc;

        var pageviews = rhinodoc.Views.GetPageViews();


        List<Guid> viewportId = new List<Guid>();
        List<string> pageNames = new List<string>();
        
    
        foreach (var page in pageviews)
        {
            Guid id = page.MainViewport.Id;
            string pagenames = page.PageName;

            

            viewportId.Add(id);
            pageNames.Add(pagenames);
        }

        rhinodoc.Views.Redraw();

        a = viewportId;
        b = pageNames;
    }
}
# ---------- end c_script ----------
button = Button()
list_item = ListItem(List=c_script.a, Index="1", Wrap=True)
panel = Panel(c_script.a)
panel_2 = Panel("""0
1
2""")
c_script_2 = CSharpScript(reset=Button())  # -> out, a, b, c
# ---------- c_script_2: C# ----------
// Grasshopper Script Instance
#region Usings
using System;
using System.Linq;
using System.Collections;
using System.Collections.Generic;
using System.Drawing;

using Rhino;
using Rhino.Geometry;

using Grasshopper;
using Grasshopper.Kernel;
using Grasshopper.Kernel.Data;
using Grasshopper.Kernel.Types;
#endregion

public class Script_Instance : GH_ScriptInstance
{
    #region Notes
    /* 
      Members:
        RhinoDoc RhinoDocument
        GH_Document GrasshopperDocument
        IGH_Component Component
        int Iteration

      Methods (Virtual & overridable):
        Print(string text)
        Print(string format, params object[] args)
        Reflect(object obj)
        Reflect(object obj, string method_name)
    */
    #endregion

    private void RunScript(object reset, ref object a, ref object b, ref object c)
    {
        RhinoDoc rhinodoc = RhinoDoc.ActiveDoc;

        var pageviews = rhinodoc.Views.GetPageViews();


        List<Guid> viewportId = new List<Guid>();
        List<string> pageNames = new List<string>();
        List<int>pagenum = new List<int>();
        
    
        foreach (var page in pageviews)
        {
            Guid id = page.MainViewport.Id;
            string pagenames = page.PageName;
            int num = page.PageNumber;

            

            viewportId.Add(id);
            pageNames.Add(pagenames);
            pagenum.Add(num);
        }
        if (reset is true)
        {
            rhinodoc.Views.Redraw();
        }
        rhinodoc.Views.Redraw();

        a = viewportId;
        b = pageNames;
        c = pagenum;
    }
}
# ---------- end c_script_2 ----------
c_script_3 = CSharpScript(layoutuserId=list_item, toggle=button)  # -> out, keys, values; inputs layoutuserId: Guid, toggle: Boolean
# ---------- c_script_3: C# ----------
// Grasshopper Script Instance
#region Usings
using System;
using System.Linq;
using System.Collections;
using System.Collections.Generic;
using System.Collections.Specialized;
using System.Drawing;

using Rhino;
using Rhino.Geometry;

using Grasshopper;
using Grasshopper.Kernel;
using Grasshopper.Kernel.Data;
using Grasshopper.Kernel.Types;
#endregion

public class Script_Instance : GH_ScriptInstance
{
    #region Notes
    /* 
      Members:
        RhinoDoc RhinoDocument
        GH_Document GrasshopperDocument
        IGH_Component Component
        int Iteration

      Methods (Virtual & overridable):
        Print(string text)
        Print(string format, params object[] args)
        Reflect(object obj)
        Reflect(object obj, string method_name)
    */
    #endregion

    private void RunScript(
		Guid layoutuserId,
		bool toggle,
		ref object keys,
		ref object values)
    {
        //sanity checks
        if (layoutuserId == Guid.Empty)
        {

            AddRuntimeMessage(GH_RuntimeMessageLevel.Warning,"1. Input parameter layoutuserID failed to collect data");
            return;
            
        }



        RhinoDoc doc = RhinoDoc.ActiveDoc;

        if (toggle is true)
        {
            doc.Views.Redraw();
        }


        List<string>v = new List<string>();
        
        var page = doc.Views.Find(layoutuserId);
        var userstring = page.MainViewport.GetUserStrings();
        var Ukey = userstring.AllKeys;

        foreach (var i in Ukey)
        {
            string guidstr = layoutuserId.ToString();
            v.Add(Rhino.Runtime.TextFields.LayoutUserText(guidstr,i));
        }
        
        

        keys = Ukey;
        values = v;
        
    }
}
# ---------- end c_script_3 ----------
cull_index = CullIndex(List=c_script_2.a, Indices=panel_2, Wrap=True)
list_item_2 = ListItem(List=c_script_2.a, Index="2", Wrap=True)
concatenate = Concatenate(B="*", Fragment_A="table0", A="\", Fragment_B="B", C="*")
concatenate_2 = Concatenate(B="*", Fragment_A="table0", A="\", Fragment_B="D", C="*")
panel_3 = Panel("""1
1
0""")
concatenate_3 = Concatenate(B="*", Fragment_A="table0", A="\", Fragment_B="C", C="*")
c_script_4 = CSharpScript(layoutuserId=cull_index, toggle=button)  # -> out, keys, values; inputs layoutuserId: Guid, toggle: Boolean; same code as c_script_3
concatenate_4 = Concatenate(B="*", Fragment_A="table0", A="\", Fragment_B="A", C="*")

# ---- group: Get LayoutUserText Strings
c_script_5 = CSharpScript(x=list_item_2)  # -> out, a; inputs x: Guid
# ---------- c_script_5: C# ----------
// Grasshopper Script Instance
#region Usings
using System;
using System.Linq;
using System.Collections;
using System.Collections.Generic;
using System.Drawing;

using Rhino;
using Rhino.Geometry;

using Grasshopper;
using Grasshopper.Kernel;
using Grasshopper.Kernel.Data;
using Grasshopper.Kernel.Types;
#endregion

public class Script_Instance : GH_ScriptInstance
{
    #region Notes
    /* 
      Members:
        RhinoDoc RhinoDocument
        GH_Document GrasshopperDocument
        IGH_Component Component
        int Iteration

      Methods (Virtual & overridable):
        Print(string text)
        Print(string format, params object[] args)
        Reflect(object obj)
        Reflect(object obj, string method_name)
    */
    #endregion

    private void RunScript(Guid x, ref object a)
    {
        RhinoDoc doc = RhinoDoc.ActiveDoc;

        var page = doc.Views.Find(x);

        var s = page.MainViewport.GetUserStrings();

        a = s;
    }
}
# ---------- end c_script_5 ----------

# ----
merge = Merge(Data1=concatenate, Data2=concatenate_2)
merge_2 = Merge(Data1=concatenate_4, Data2=concatenate_3)
panel_4 = Panel("""COVER

OVERVIEW""")
cull_pattern = CullPattern(List=c_script_4.values, CullPattern=panel_3)
match_text = MatchText(Text=c_script_3.keys, Pattern=graft(merge), Case=True)
match_text_2 = MatchText(Text=c_script_3.keys, Pattern=graft(merge_2), Case=True)
concatenate_5 = Concatenate(B="*", Fragment_A="table3", A="\", Fragment_B="A", C="*")
concatenate_6 = Concatenate(B="*", Fragment_A="table3", A="\", Fragment_B="B", C="*")
concatenate_7 = Concatenate(B="*", Fragment_A="table3", A="\", Fragment_B="C", C="*")
merge_3 = Merge(Data1=panel_4, Data2=cull_pattern)  # -> flatten(Result)
panel_5 = Panel(c_script_4.values)

# ---- group: ITEM NO
cull_pattern_2 = CullPattern(List=c_script_3.keys, CullPattern=match_text_2)  # -> flatten(List)

# ---- group: DESCRIP
cull_pattern_3 = CullPattern(List=c_script_3.keys, CullPattern=match_text)  # -> flatten(List)

# ----
merge_4 = Merge(Data1=concatenate_5, Data2=concatenate_6, Data3=concatenate_7)
partition_list = PartitionList(List=merge_3, Size="2")
# G00
match_text_3 = MatchText(Text=c_script_5.a, Pattern=graft(merge_4), Case=True)
concatenate_8 = Concatenate(FragmentA=partition_list, FragmentB=" ")

# ---- group: ITEM NO
cull_pattern_4 = CullPattern(List=c_script_5.a, CullPattern=match_text_3)

# ----
c_script_6 = CSharpScript()  # -> out, keys, values
# ---------- c_script_6: C# ----------
// Grasshopper Script Instance
#region Usings
using System;
using System.Linq;
using System.Collections;
using System.Collections.Generic;
using System.Collections.Specialized;
using System.Drawing;

using Rhino;
using Rhino.Geometry;

using Grasshopper;
using Grasshopper.Kernel;
using Grasshopper.Kernel.Data;
using Grasshopper.Kernel.Types;
#endregion

public class Script_Instance : GH_ScriptInstance
{
    #region Notes
    /* 
      Members:
        RhinoDoc RhinoDocument
        GH_Document GrasshopperDocument
        IGH_Component Component
        int Iteration

      Methods (Virtual & overridable):
        Print(string text)
        Print(string format, params object[] args)
        Reflect(object obj)
        Reflect(object obj, string method_name)
    */
    #endregion

    private void RunScript(ref object keys, ref object values)
    {
        var view = RhinoDoc.ActiveDoc.Views.ActiveView;

        if (view == null)
            return;

        NameValueCollection userText =
            view.MainViewport.GetUserStrings();

        var Akeys = new List<string>();
        var Avalues = new List<string>();

        foreach (string key in userText.AllKeys)
        {
            Akeys.Add(key);
            Avalues.Add(userText[key]);
        }

        keys = Akeys;
        values = Avalues;
    }
}
# ---------- end c_script_6 ----------
panel_6 = Panel(merge_2)
text_join = TextJoin(Text=concatenate_8)  # -> flatten(Result)
explode_tree = ExplodeTree(Data=cull_pattern_4)  # -> Branch0, Branch1, Branch2

# ---- group: RESET VALUES
c_script_7 = CSharpScript(x=c_script_6.keys, y="--", toggle=Button())  # -> out, a; inputs x: list of String, y: String, toggle: Boolean
# ---------- c_script_7: C# ----------
// Grasshopper Script Instance
#region Usings
using System;
using System.Linq;
using System.Collections;
using System.Collections.Generic;
using System.Drawing;

using Rhino;
using Rhino.Geometry;

using Grasshopper;
using Grasshopper.Kernel;
using Grasshopper.Kernel.Data;
using Grasshopper.Kernel.Types;
#endregion

public class Script_Instance : GH_ScriptInstance
{
    #region Notes
    /* 
      Members:
        RhinoDoc RhinoDocument
        GH_Document GrasshopperDocument
        IGH_Component Component
        int Iteration

      Methods (Virtual & overridable):
        Print(string text)
        Print(string format, params object[] args)
        Reflect(object obj)
        Reflect(object obj, string method_name)
    */
    #endregion

    private void RunScript(List<string> x, string y, bool toggle, ref object a)
    {
        RhinoDoc doc = RhinoDoc.ActiveDoc;

        Guid layoutid = new Guid("555f892c-cc6f-4a2a-be12-98ab1795e454");
        var page = doc.Views.Find(layoutid);

        if (toggle is true)
        {
            foreach (string keys in x)
            {
                a = page.MainViewport.SetUserString(keys,y);
            }
        }


    }
}
# ---------- end c_script_7 ----------

# ----
list_length = ListLength(List=text_join)
list_length_2 = ListLength(List=explode_tree.Branch1)
list_length_3 = ListLength(List=explode_tree.Branch0)
construct_domain = ConstructDomain(DomainStart=0, DomainEnd=1)
subtraction = Subtraction(A=list_length_2, B=list_length)
c_script_8 = CSharpScript()  # -> out, a
# ---------- c_script_8: C# ----------
// Grasshopper Script Instance
#region Usings
using System;

#endregion

public class Script_Instance : GH_ScriptInstance
{
    #region Notes
    /* 
      Members:
        RhinoDoc RhinoDocument
        GH_Document GrasshopperDocument
        IGH_Component Component
        int Iteration

      Methods (Virtual & overridable):
        Print(string text)
        Print(string format, params object[] args)
        Reflect(object obj)
        Reflect(object obj, string method_name)
    */
    #endregion

    private void RunScript(ref object a)
    {
        string todayText = DateTime.Now.ToString("yyyy-MM-dd");
        a = todayText;
    }
}
# ---------- end c_script_8 ----------
series = Series(Start="1", Step="1", Count=list_length)
panel_7 = Panel(explode_tree.Branch0)
duplicate_data = DuplicateData(Data="--", Number=subtraction, Order=True)
duplicate_data_2 = DuplicateData(Data=c_script_8.a, Number=list_length, Order=True)
entwine = Entwine(Branch00=series, Branch01=duplicate_data, FlattenInputs=True)  # -> flatten(Result)
entwine_2 = Entwine(Branch00=text_join, Branch01=duplicate_data, FlattenInputs=True)  # -> flatten(Result)
entwine_3 = Entwine(Branch00=duplicate_data_2, Branch01=duplicate_data, FlattenInputs=True)  # -> flatten(Result)
c_script_9 = CSharpScript(LayoutKey=graft(explode_tree.Branch0), values=graft(entwine), layoutGuid=list_item_2)  # -> out, a; inputs LayoutKey: list of String, values: String, layoutGuid: Guid
# ---------- c_script_9: C# ----------
// Grasshopper Script Instance
#region Usings
using System;
using System.Linq;
using System.Collections;
using System.Collections.Generic;
using System.Drawing;

using Rhino;
using Rhino.Geometry;

using Grasshopper;
using Grasshopper.Kernel;
using Grasshopper.Kernel.Data;
using Grasshopper.Kernel.Types;
#endregion

public class Script_Instance : GH_ScriptInstance
{
    #region Notes
    /* 
      Members:
        RhinoDoc RhinoDocument
        GH_Document GrasshopperDocument
        IGH_Component Component
        int Iteration

      Methods (Virtual & overridable):
        Print(string text)
        Print(string format, params object[] args)
        Reflect(object obj)
        Reflect(object obj, string method_name)
    */
    #endregion

    private void RunScript(
		List<string> LayoutKey,
		string values,
		Guid layoutGuid,
		ref object a)
    {
        RhinoDoc doc = RhinoDoc.ActiveDoc;

        var page = doc.Views.Find(layoutGuid);

        foreach (var s in LayoutKey)
        {
            var test = page.MainViewport.SetUserString(s,values);
        }
        
    }
}
# ---------- end c_script_9 ----------
c_script_10 = CSharpScript(LayoutKey=graft(explode_tree.Branch1), values=graft(entwine_2), layoutGuid=list_item_2)  # -> out, a; inputs LayoutKey: list of String, values: String, layoutGuid: Guid
# ---------- c_script_10: C# ----------
// Grasshopper Script Instance
#region Usings
using System;
using System.Linq;
using System.Collections;
using System.Collections.Generic;
using System.Drawing;

using Rhino;
using Rhino.Geometry;

using Grasshopper;
using Grasshopper.Kernel;
using Grasshopper.Kernel.Data;
using Grasshopper.Kernel.Types;
#endregion

public class Script_Instance : GH_ScriptInstance
{
    #region Notes
    /* 
      Members:
        RhinoDoc RhinoDocument
        GH_Document GrasshopperDocument
        IGH_Component Component
        int Iteration

      Methods (Virtual & overridable):
        Print(string text)
        Print(string format, params object[] args)
        Reflect(object obj)
        Reflect(object obj, string method_name)
    */
    #endregion

    private void RunScript(
		List<string> LayoutKey,
		string values,
		Guid layoutGuid,
		ref object a)
    {
        RhinoDoc doc = RhinoDoc.ActiveDoc;

        var page = doc.Views.Find(layoutGuid);

        foreach (var s in LayoutKey)
        {
            var test = page.MainViewport.SetUserString(s,values);
        }
    }
}
# ---------- end c_script_10 ----------
c_script_11 = CSharpScript(LayoutKey=graft(explode_tree.Branch2), values=graft(entwine_3), layoutGuid=list_item_2)  # -> out, a; inputs LayoutKey: list of String, values: String, layoutGuid: Guid
# ---------- c_script_11: C# ----------
// Grasshopper Script Instance
#region Usings
using System;
using System.Linq;
using System.Collections;
using System.Collections.Generic;
using System.Drawing;

using Rhino;
using Rhino.Geometry;

using Grasshopper;
using Grasshopper.Kernel;
using Grasshopper.Kernel.Data;
using Grasshopper.Kernel.Types;
#endregion

public class Script_Instance : GH_ScriptInstance
{
    #region Notes
    /* 
      Members:
        RhinoDoc RhinoDocument
        GH_Document GrasshopperDocument
        IGH_Component Component
        int Iteration

      Methods (Virtual & overridable):
        Print(string text)
        Print(string format, params object[] args)
        Reflect(object obj)
        Reflect(object obj, string method_name)
    */
    #endregion

    private void RunScript(
		List<string> LayoutKey,
		string values,
		Guid layoutGuid,
		ref object a)
    {
        RhinoDoc doc = RhinoDoc.ActiveDoc;

        var page = doc.Views.Find(layoutGuid);

        string todayText = DateTime.Now.ToString("yyyy-MM-dd");     
        
        foreach (var s in LayoutKey)
        {
            var test = page.MainViewport.SetUserString(s,values);
        }
    }
}
# ---------- end c_script_11 ----------
