# Grasshopper definition DMesh Test.gh (Grasshopper 1.0.8)
# plug-ins: RhinoCodePluginGH, Pufferfish

mesh = Mesh(<mesh referenced from the Rhino model>)
mesh_2 = Mesh(<mesh referenced from the Rhino model>)
mesh_statistics = MeshStatistics(Mesh=mesh_2)  # -> VertexCount, FaceCount, QuadFaceCount, TriangleFaceCount, ColorCount, PieceCount
c_script = CSharpScript(mesh=mesh)  # -> out, a; inputs mesh: Mesh
# ---------- c_script: C# ----------
// Grasshopper Script Instance
#region Usings
using System;
//#r "C:\Users\clark.cheng\OneDrive - UAP Company\Desktop\_COMMONS\UAP-Plugins\02_GH\_lib\geometry4Sharp-main\geometry4Sharp-main\bin\Release\geometry4sharp.dll"
#r "D:\_MAIN\Architectural Templates\UAP-Plugins\02_GH\_lib\geometry4Sharp-main\bin\Release\geometry4sharp.dll"
using System.Linq;
using System.Collections;
using System.Collections.Generic;
using System.Drawing;

using Rhino;
using Rhino.Geometry;

using Grasshopper;
using Grasshopper.Kernel;
using Grasshopper.Kernel.Data;
using Grasshopper.Kernel.Types;

using g4;
#endregion

public class Script_Instance : GH_ScriptInstance
{
    #region Notes
    /* 
      Members:
        RhinoDoc RhinoDocument
        GH_Document GrasshopperDocument
        IGH_Component Component
        int Iteration

      Methods (Virtual & overridable):
        Print(string text)
        Print(string format, params object[] args)
        Reflect(object obj)
        Reflect(object obj, string method_name)
    */
    #endregion

    private void RunScript(Mesh mesh, ref object a)
    {
        // Write your logic here
        DMesh3 dm= new DMesh3(true,true,true,true);

        for (int i =0;i<mesh.Vertices.Count;i++)
        {
            Point3f vert=mesh.Vertices[i];
            
            g4.Vector3d v3 = new g4.Vector3d(vert.X,vert.Y,vert.Z);
            dm.AppendVertex(v3);
        }

        for (int i=0; i<mesh.Faces.Count;i++)
        {
            MeshFace mf =mesh.Faces.GetFace(i);
            dm.AppendTriangle(mf.A,mf.B,mf.C);
        }

        a=dm;
    }
}
# ---------- end c_script ----------
c_script_2 = CSharpScript(mesh=mesh_2)  # -> out, a; inputs mesh: Mesh; same code as c_script

# ---- group: Mesh BooleanUnion
c_script_3 = CSharpScript(x=c_script_2.a, y=c_script.a)  # -> out, a
# ---------- c_script_3: C# ----------
// Grasshopper Script Instance
#region Usings
using System;
#r "D:\_MAIN\Architectural Templates\UAP-Plugins\02_GH\_lib\geometry4Sharp-main\bin\Release\geometry4sharp.dll"
using System.Linq;
using System.Collections;
using System.Collections.Generic;
using System.Drawing;

using Rhino;
using Rhino.Geometry;

using Grasshopper;
using Grasshopper.Kernel;
using Grasshopper.Kernel.Data;
using Grasshopper.Kernel.Types;
using g4;
#endregion

public class Script_Instance : GH_ScriptInstance
{
    #region Notes
    /* 
      Members:
        RhinoDoc RhinoDocument
        GH_Document GrasshopperDocument
        IGH_Component Component
        int Iteration

      Methods (Virtual & overridable):
        Print(string text)
        Print(string format, params object[] args)
        Reflect(object obj)
        Reflect(object obj, string method_name)
    */
    #endregion

    private void RunScript(object x, object y, ref object a)
    {
         // Initialize MeshBoolean object
        DMesh3 meshA=x as DMesh3; 
        DMesh3 meshB=y as DMesh3;

        MeshBoolean meshBoolean = new MeshBoolean
        {
            Target = meshA,
            Tool = meshB,
            VertexSnapTol = 0.00001
        };

        // Perform the boolean operation
        if (meshBoolean.Compute())
        {
            // Assign the result to the output parameter
            a=meshBoolean.Result;
        }
        else
        {
            Print("Boolean computation failed.");
        }

        
    }
}
# ---------- end c_script_3 ----------

# ---- group: Mesh BooleanDifference
c_script_4 = CSharpScript(x=c_script_2.a, y=c_script.a)  # -> out, a
# ---------- c_script_4: C# ----------
// Grasshopper Script Instance
#region Usings
using System;
#r "D:\_MAIN\Architectural Templates\UAP-Plugins\02_GH\_lib\geometry4Sharp-main\bin\Release\geometry4sharp.dll"
using System.Linq;
using System.Collections;
using System.Collections.Generic;
using System.Drawing;

using Rhino;
using Rhino.Geometry;

using Grasshopper;
using Grasshopper.Kernel;
using Grasshopper.Kernel.Data;
using Grasshopper.Kernel.Types;
using g4;
#endregion

public class Script_Instance : GH_ScriptInstance
{
    #region Notes
    /* 
      Members:
        RhinoDoc RhinoDocument
        GH_Document GrasshopperDocument
        IGH_Component Component
        int Iteration

      Methods (Virtual & overridable):
        Print(string text)
        Print(string format, params object[] args)
        Reflect(object obj)
        Reflect(object obj, string method_name)
    */
    #endregion

    private void RunScript(object x, object y, ref object a)
    {
         // Initialize MeshBoolean object
        DMesh3 meshA=x as DMesh3; 
        DMesh3 meshB=y as DMesh3;

        MeshBoolean meshBoolean = new MeshBoolean
        {
            Target = meshA,
            Tool = meshB,
            VertexSnapTol = 0.00001
        };

        // Perform the boolean operation
        if (meshBoolean.Compute())
        {
            // Copy the resulting mesh after boolean operation
            DMesh3 differenceMesh = new DMesh3(meshBoolean.Result);

            // Remove faces that are too close to the Tool mesh, simulating a difference operation
            RemoveIntersectingFaces(differenceMesh, toolDMesh, meshBoolean.VertexSnapTol);
        }
        else
        {
            Print("Boolean computation failed.");
        }

        
    }
}
# ---------- end c_script_4 ----------

# ----
c_script_5 = CSharpScript(x=c_script_3.a)  # -> out, a
# ---------- c_script_5: C# ----------
// Grasshopper Script Instance
#region Usings
using System;
#r "D:\_MAIN\Architectural Templates\UAP-Plugins\02_GH\_lib\geometry4Sharp-main\bin\Release\geometry4sharp.dll"
using System.Linq;
using System.Collections;
using System.Collections.Generic;
using System.Drawing;

using Rhino;
using Rhino.Geometry;

using Grasshopper;
using Grasshopper.Kernel;
using Grasshopper.Kernel.Data;
using Grasshopper.Kernel.Types;
using g4;
#endregion

public class Script_Instance : GH_ScriptInstance
{
    #region Notes
    /* 
      Members:
        RhinoDoc RhinoDocument
        GH_Document GrasshopperDocument
        IGH_Component Component
        int Iteration

      Methods (Virtual & overridable):
        Print(string text)
        Print(string format, params object[] args)
        Reflect(object obj)
        Reflect(object obj, string method_name)
    */
    #endregion

    private void RunScript(object x, ref object a)
    {
        DMesh3 dm=x as DMesh3;

        Mesh converted_DMesh=new Mesh();

        int vertCount=dm.VertexCount;
        Console.WriteLine(vertCount);

        for (int i=0;i<dm.VertexCount;i++)
        {
            if (dm.IsVertex(i))
            {
                g4.Vector3d v=dm.GetVertex(i);
                converted_DMesh.Vertices.Add(v.x,v.y,v.z);
                
            }
        }
        int count=dm.TriangleCount;
        Console.WriteLine(count);
        for (int i=0;i<dm.TriangleCount;i++)
        {
            Index3i t=dm.GetTriangle(i);
            converted_DMesh.Faces.AddFace(t.a,t.b,t.c);
            Console.WriteLine(t);
            /*if (dm.IsTriangle(i))
            {
                Index3i t=dm.GetTriangle(i);
                converted_DMesh.Faces.AddFace(t.a,t.b,t.c);
                Console.WriteLine(converted_DMesh.Faces.AddFace(t.a,t.b,t.c));
            }
            */
        }
        //converted_DMesh.RebuildNormals();


        a=converted_DMesh;
    }   

}
# ---------- end c_script_5 ----------
mesh_3 = Mesh(c_script_5.a)
rebuild_mesh = RebuildMesh(
    Mesh=mesh_3,
    RebuildNormals="1",
    CullUnused="1",
    UnifyNormals="1",
    FlipNormals="1",
    IdenticalCombine="1",
    WeldVertices="0.01")
panel = Panel(c_script_5.a)
