# Grasshopper definition MeshLib.gh (Grasshopper 1.0.8)
# plug-ins: Pufferfish, Weaverbird

mesh = Mesh(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)
mesh_2 = Mesh(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)
close_mesh = CloseMesh(Mesh=mesh_2, Quadrangulate=False)  # -> Closed, Amount, Openings, ResultBoolean
close_mesh_2 = CloseMesh(Mesh=mesh, Quadrangulate=False)  # -> Closed, Amount, Openings, ResultBoolean
weaverbird_s_loop_subdivision = WeaverbirdsLoopSubdivision(MeshCurves=close_mesh.Closed, Level=1, SmoothNakedEdges=1)
weaverbird_s_loop_subdivision_2 = WeaverbirdsLoopSubdivision(MeshCurves=close_mesh_2.Closed, Level=1, SmoothNakedEdges=1)
number_slider = Slider(0.1, range=0..0.1)
c_script = CSharpScript()  # -> out, mrMesh
# ---------- c_script: C# ----------
// Grasshopper Script Instance
#region Usings
using System;
#r "D:\Architectural Templates\Ptarmigan\02_GH\_lib\MeshLib-master\MeshLib\MeshLib\bin\Debug\MeshLib.dll"
#r "D:\Architectural Templates\Ptarmigan\02_GH\_lib\MeshLib-master\MeshLib\MeshLib\bin\Debug\MRDotNet.dll"
using System.Linq;
using System.Collections;
using System.Collections.Generic;
using System.Drawing;

using Rhino;
using Rhino.Geometry;

using MeshLibDemo;

using Grasshopper;
using Grasshopper.Kernel;
using Grasshopper.Kernel.Data;
using Grasshopper.Kernel.Types;
#endregion

public class Script_Instance : GH_ScriptInstance
{
    #region Notes
    /* 
      Members:
        RhinoDoc RhinoDocument
        GH_Document GrasshopperDocument
        IGH_Component Component
        int Iteration

      Methods (Virtual & overridable):
        Print(string text)
        Print(string format, params object[] args)
        Reflect(object obj)
        Reflect(object obj, string method_name)
    */
    #endregion

    private void RunScript(ref object mrMesh)
    {
        var verts = new List<MR.DotNet.Vector3f>
            {
                new MR.DotNet.Vector3f(0f, 0f, 0f),
                new MR.DotNet.Vector3f(1f, 0f, 0f),
                new MR.DotNet.Vector3f(0f, 1f, 0f)
            };

            var tris = new List<MR.DotNet.ThreeVertIds>
            {
                new MR.DotNet.ThreeVertIds(
                    new MR.DotNet.VertId(0),
                    new MR.DotNet.VertId(1),
                    new MR.DotNet.VertId(2)
                )
            };

            // Call your method from the external class
            mrMesh = MeshLibDemo.Program
    }
}
# ---------- end c_script ----------
c_script_2 = CSharpScript()  # -> out, a; inputs x: Vector3d, y: Vector3d
# ---------- c_script_2: C# ----------
// Grasshopper Script Instance
#region Usings
using System;
using System.Linq;
using System.Collections;
using System.Collections.Generic;
using System.Drawing;

using Rhino;
using Rhino.Geometry;

using Grasshopper;
using Grasshopper.Kernel;
using Grasshopper.Kernel.Data;
using Grasshopper.Kernel.Types;
#endregion

public class Script_Instance : GH_ScriptInstance
{
    #region Notes
    /* 
      Members:
        RhinoDoc RhinoDocument
        GH_Document GrasshopperDocument
        IGH_Component Component
        int Iteration

      Methods (Virtual & overridable):
        Print(string text)
        Print(string format, params object[] args)
        Reflect(object obj)
        Reflect(object obj, string method_name)
    */
    #endregion

    private void RunScript(Vector3d x, Vector3d y, ref object a)
    {
        Vector3d v = Vector3d.CrossProduct(x,y);
        a=v;
    }
}
# ---------- end c_script_2 ----------
