# Grasshopper definition 2D Grid Distortion.gh (Grasshopper 1.0.8)
# plug-ins: Human

# ----
# LEGEND
# Parameters
# Basic Groups
# Inputs
# Outputs
# Exports /
# Data Outputs
# /Display
# Display
# Local Testing
# Ready to
# Organize
# In Progress /
# To Implement
data = Data()
data_2 = Data()
data_3 = Data()
data_4 = Data()
data_5 = Data()
data_6 = Data()
data_7 = Data()
data_8 = Data()
data_9 = Data()

# ----
# Feedback /
# Improvements
data_10 = Data()
# Reference
# Geometry
data_11 = Data()
number_slider = Slider(7.37, range=0..10)
number_slider_2 = Slider(31, range=0..100)
number_slider_3 = Slider(28.91, range=0..100)
surface = Surface(<surface referenced from the Rhino model>)
divide_surface = DivideSurface(Surface=surface, UCount=number_slider_2, VCount=number_slider_2)  # -> Points, Normals, Parameters
point = Point(graft([<point referenced from the Rhino model> x5]))

flatten_tree = FlattenTree(Tree=divide_surface.Points, Path="{0}")
distance = Distance(PointA=flatten_tree, PointB=point)
smaller_than = SmallerThan(FirstNumber=distance, SecondNumber=number_slider_3)  # -> SmallerThan, OrEqualTo
sift_pattern = SiftPattern(List=flatten_tree, SiftPattern=smaller_than.SmallerThan)  # -> Output0, Output1

colour_picker = ColourPicker(PickedColour=RGB(43, 224, 67))
circle = Circle(Plane=point, Radius=number_slider_3)
custom_preview_lineweights = CustomPreviewLineweights(Geometry=circle, Shader=colour_picker, Thickness=Slider(6.4, range=0..10), Absolute=False)
point_2 = Point(sift_pattern.Output1)
flatten_tree_2 = FlattenTree(Tree=point_2, Path="{0}")

replace_nulls = ReplaceNulls(Items=flatten_tree_2, Replacements="0")  # -> Items, Count
equality = Equality(FirstNumber=replace_nulls.Items, SecondNumber="0")  # -> Equality, Inequality
sift_pattern_2 = SiftPattern(List=flatten_tree_2, SiftPattern=equality.Inequality)  # -> Output0, Output1

create_set = CreateSet(List=sift_pattern_2.Output1)  # -> Set, Map
member_index = MemberIndex(Set=sift_pattern_2.Output1, Member=create_set.Set)  # -> Index, Count
equality_2 = Equality(FirstNumber=member_index.Count, SecondNumber="1")  # -> graft(Equality), Inequality

cull_pattern = CullPattern(List=member_index.Index, CullPattern=invert(equality_2.Equality))  # -> flatten(List)
replace_items = ReplaceItems(List=sift_pattern_2.Output1, Indices=cull_pattern, Wrap=False)
unflatten_tree = UnflattenTree(Tree=replace_items, Guide=point_2)

vector_2pt = Vector2Pt(PointA=point, PointB=unflatten_tree, Unitize=False)  # -> Vector, Length
replace_nulls_2 = ReplaceNulls(Items=vector_2pt.Vector, Replacements="{0,0,0}")  # -> Items, Count
flip_matrix = FlipMatrix(Data=replace_nulls_2.Items)
mass_addition = MassAddition(Input=flip_matrix)  # -> Result, PartialResults
flip_matrix_2 = FlipMatrix(Data=mass_addition.Result)

flatten_tree_3 = FlattenTree(Tree=point, Path="{0}")
closest_point = ClosestPoint(Point=flatten_tree, Cloud=flatten_tree_3)  # -> ClosestPoint, CPIndex, Distance
bounds = Bounds(Numbers=closest_point.Distance)
remap_numbers = RemapNumbers(Value=closest_point.Distance, Source=bounds, Target=Domain(0, 1))  # -> Mapped, Clipped
graph_mapper = GraphMapper(
    simplify(remap_numbers.Mapped),
    x0=0,
    x1=1,
    y0=0,
    y1=1,
    container_name="Gaussian",
    factor=0.2,
    mean=0.08965091407,
    sdev=0.1220508479)
bounds_2 = Bounds(Numbers=graph_mapper)
remap_numbers_2 = RemapNumbers(Value=graph_mapper, Source=bounds_2, Target=Slider(5.75, range=-10..10))  # -> Mapped, Clipped
amplitude = Amplitude(Vector=flip_matrix_2, Amplitude=remap_numbers_2.Mapped)

cull_pattern_2 = CullPattern(List=member_index.Index, CullPattern=invert(equality_2.Equality))
list_length = ListLength(List=cull_pattern_2)
larger_than = LargerThan(FirstNumber=list_length, SecondNumber="0")  # -> LargerThan, OrEqualTo
cull_pattern_3 = CullPattern(List=list_length, CullPattern=larger_than.LargerThan)

move = Move(Geometry=flatten_tree, Motion=amplitude)  # -> Geometry, Transform
unflatten_tree_2 = UnflattenTree(Tree=move.Geometry, Guide=divide_surface.Points)

panel = Panel(cull_pattern_2)

flip_matrix_3 = FlipMatrix(Data=unflatten_tree_2)
interpolate = Interpolate(Vertices=flip_matrix_3, Degree=3, Periodic=False, KnotStyle=1)  # -> Curve, Length, Domain
extend_curve = ExtendCurve(Curve=interpolate.Curve, Type=0, Start=number_slider, End=number_slider)

interpolate_2 = Interpolate(Vertices=unflatten_tree_2, Degree=3, Periodic=False, KnotStyle=1)  # -> Curve, Length, Domain
extend_curve_2 = ExtendCurve(Curve=interpolate_2.Curve, Type=0, Start=number_slider, End=number_slider)

panel_2 = Panel(cull_pattern_3)
