# Grasshopper definition Gait Curve Example.gh (Grasshopper 1.0.8)

curve = Curve(<curve referenced from the Rhino model>)
curve_2 = Curve(<curve referenced from the Rhino model>)
divide_surface = DivideSurface(Surface=curve, UCount=10, VCount=10)  # -> Points, Normals, Parameters
polygon = Polygon(Plane=divide_surface.Points, Radius=Slider(5.59, range=0..10), Segments="3", FilletRadius=0)  # -> Polygon, Length
pull_point = PullPoint(Point=divide_surface.Points, Geometry=curve_2, ClosestOnly=True)  # -> ClosestPoint, Distance, Index
rotate = Rotate(Geometry=polygon.Polygon, Angle=1.570796327, Plane=divide_surface.Points)  # -> Geometry, Transform
curve_closest_point = CurveClosestPoint(Point=divide_surface.Points, Curve=curve_2)  # -> Point, Parameter, Distance
unit_y = UnitY(Factor=1)
panel = Panel(pull_point.ClosestPoint)
evaluate_curve = EvaluateCurve(Curve=curve_2, Parameter=curve_closest_point.Parameter)  # -> Point, Tangent, Angle
vector_display = VectorDisplay(Anchor=divide_surface.Points, Vector=evaluate_curve.Tangent)
orient_direction = OrientDirection(
    Geometry=rotate.Geometry,
    PointA=divide_surface.Points,
    DirectionA=unit_y,
    PointB=divide_surface.Points,
    DirectionB=evaluate_curve.Tangent)  # -> Geometry, Transform
