# Grasshopper definition Minkowsi Sum.gh (Grasshopper 1.0.8)
# plug-ins: Pufferfish, Clipper2

number_slider = Slider(3.07, range=0..10)
curve = Curve(<curve referenced from the Rhino model>)
number_slider_2 = Slider(1, range=0..1)
circle = Circle(Plane=PlaneXY(0, 0, 0), Radius=number_slider)
curve_2 = Curve([<curve referenced from the Rhino model> x3])
xy_plane = XYPlane(Origin=Point(0, 0, 0))
c_script = CSharpScript()  # -> out, a
# ---------- c_script: C# ----------
// Grasshopper Script Instance
#region Usings
using System;
using System.Linq;
using System.Collections;
using System.Collections.Generic;
using System.Drawing;

using Rhino;
using Rhino.Geometry;

using Grasshopper;
using Grasshopper.Kernel;
using Grasshopper.Kernel.Data;
using Grasshopper.Kernel.Types;
#endregion

public class Script_Instance : GH_ScriptInstance
{
    #region Notes
    /* 
      Members:
        RhinoDoc RhinoDocument
        GH_Document GrasshopperDocument
        IGH_Component Component
        int Iteration

      Methods (Virtual & overridable):
        Print(string text)
        Print(string format, params object[] args)
        Reflect(object obj)
        Reflect(object obj, string method_name)
    */
    #endregion

    private void RunScript(object x, object y, ref object a)
    {
        string f = "hello";
        System.Console.WriteLine(f);
        Console.WriteLine("hello");

        a = null;
    }
}
# ---------- end c_script ----------
c_script_2 = CSharpScript(seg=Slider(64, range=0..100), radius=Slider(2, range=0..10))  # -> out, a; inputs crv: Curve, seg: Int32, radius: Double
# ---------- c_script_2: C# ----------
// Grasshopper Script Instance
#region Usings
using System;
#r "D:\Architectural Templates\Ptarmigan\02_GH\_lib\Clipper2-main\Clipper2-main\Clipper2Lib.dll"
using System.Linq;
using System.Collections;
using System.Collections.Generic;
using System.Drawing;

using Rhino;
using Rhino.Geometry;

using Clipper2Lib;

using Grasshopper;
using Grasshopper.Kernel;
using Grasshopper.Kernel.Data;
using Grasshopper.Kernel.Types;
#endregion

public class Script_Instance : GH_ScriptInstance
{
    #region Notes
    /* 
      Members:
        RhinoDoc RhinoDocument
        GH_Document GrasshopperDocument
        IGH_Component Component
        int Iteration

      Methods (Virtual & overridable):
        Print(string text)
        Print(string format, params object[] args)
        Reflect(object obj)
        Reflect(object obj, string method_name)
    */
    #endregion

    private void RunScript(Curve crv, int seg, double radius, ref object a)
    {
        PathD pattern = new PathD();

        for (int i=0; i<seg; i++)
        {
            double angle = Math.PI*i/seg;

            double x = radius*Math.Cos(angle);
            double y = radius*Math.Sin(angle);

            pattern.Add(new PointD(x, y));
        }

        // Write your logic here
        a = null;
    }
}
# ---------- end c_script_2 ----------
c_script_3 = CSharpScript(crv=curve, div=Slider(100, range=0..100), offset=number_slider)  # -> out, a, b; inputs crv: Curve, div: Int32, offset: Double; disabled
# ---------- c_script_3: C# ----------
// Grasshopper Script Instance
#region Usings
using System;
using System.Linq;
using System.Collections;
using System.Collections.Generic;
using System.Drawing;

#r "D:\Architectural Templates\Ptarmigan\02_GH\_lib\Clipper2-main\Clipper2-main\Clipper2Lib.dll"

using Clipper2Lib;
using static Clipper2Lib.Clipper;






using Rhino;
using Rhino.Geometry;

using Grasshopper;
using Grasshopper.Kernel;
using Grasshopper.Kernel.Data;
using Grasshopper.Kernel.Types;
#endregion

public class Script_Instance : GH_ScriptInstance
{
    #region Notes
    /* 
      Members:
        RhinoDoc RhinoDocument
        GH_Document GrasshopperDocument
        IGH_Component Component
        int Iteration

      Methods (Virtual & overridable):
        Print(string text)
        Print(string format, params object[] args)
        Reflect(object obj)
        Reflect(object obj, string method_name)
    */
    #endregion

    private void RunScript(
		Curve crv,
		int div,
		double offset,
		ref object a,
		ref object b)
    {
        List<Point3d> sample = new List<Point3d>();
        Point3d[] divpts;

        crv.DivideByCount(div,true, out divpts);

        sample.AddRange(divpts);

        //Convert from Rhino.Crv to Path64
        Path64 path = new Path64();
        double scale = 100000;
        foreach (Point3d pt in sample)
        {
            long x = (long)(pt.X * scale);
            long y = (long)(pt.Y * scale);
            path.Add(new Point64(x, y));
        }

        //create circle with polys

        int seg=64;
        List<Point3d> circle = new List<Point3d>();

        for (int i=0; i<seg; i++)
        {
            double angle=2*Math.PI*i/seg;

            circle.Add(new Point3d(offset*Math.Cos(angle),offset*Math.Sin(angle),0));
            
        }
        b=circle;

        //convert to Path64
        Path64 clipper_circle = new Path64();
        foreach (Point3d pt in circle)
        {
            double x = pt.X;
            double y = pt.Y;
            double z = pt.Z;

            clipper_circle.Add(new Point64((long)x*scale,(long)y*scale));
        }

        Paths64 result = Clipper.MinkowskiSum(clipper_circle,path,true);


        List<List<Point3d>> allMinkowskiPts = new List<List<Point3d>>();

        foreach (Path64 mcrv in result)
        {
            List<Point3d> mpts = new List<Point3d>();

            foreach (Point64 pt in mcrv)
            {
                double x = (double) pt.X / scale;
                double y = (double) pt.Y / scale;
                mpts.Add(new Point3d(x, y, 0));
            }

            allMinkowskiPts.Add(mpts);
        }

        // ✅ Flatten outside the loop
        List<Point3d> flatPts = new List<Point3d>();
        foreach (List<Point3d> group in allMinkowskiPts)
        {
            flatPts.AddRange(group);
        }

        // ✅ Output to Grasshopper
        a = flatPts;

        Print("Minkowski result count: " + result.Count);
        Print("Scaled offset: " + (offset * scale));




            

            
    }

        


        //b=circle;

    
}
# ---------- end c_script_3 ----------
clipper2_union = Clipper2Union(Polylines=curve_2, UnionRule=0, Precision=4)
curve_to_polyline = CurveToPolyline(Curve=circle, ToleranceDistance=0, ToleranceAngle=0, MaxEdge=Slider(0.06, range=0..1))  # -> Polyline, Segments
polyline = PolyLine(Vertices=c_script_3.a, Closed=False)
explode = Explode(Curve=clipper2_union, Recursive=True)  # -> Segments, Vertices
number_slider_3 = Slider(10, range=0..10)
curve_3 = Curve([<curve referenced from the Rhino model> x3])
curve_4 = Curve(<curve referenced from the Rhino model>)
curve_5 = Curve(<curve referenced from the Rhino model>)
explode_2 = Explode(Curve=curve_3, Recursive=True)  # -> Segments, Vertices
number_slider_4 = Slider(1, range=0..1)
clipper2_minkowski_sum = Clipper2MinkowskiSum(Pattern=curve_to_polyline.Polyline, Path=curve, Plane=xy_plane, IsClosed=True, Precision=4)
panel = Panel(c_script_3.a)
explode_3 = Explode(Curve=curve_4, Recursive=True)  # -> Segments, Vertices
removeduplicatepts = RemoveDuplicatePts(Points=explode.Vertices, Tolerance=0.01)
divide_curve = DivideCurve(Curve=curve_5, Count=10, Kinks=False)  # -> Points, Tangents, Parameters
curve_to_polyline_2 = CurveToPolyline(Curve=curve_4, ToleranceDistance=0, ToleranceAngle=0)  # -> Polyline, Segments
range = Range(Domain=number_slider_3, Steps=Slider(10, range=0..100))
removeduplicatepts_2 = RemoveDuplicatePts(Points=explode_2.Vertices, Tolerance=0.01)
removeduplicatepts_3 = RemoveDuplicatePts(Points=explode_3.Vertices, Tolerance=0.01)
fillet = Fillet(Curve=clipper2_minkowski_sum, Radius=number_slider)

# ---- group: Sample Script Minkowski Sum
c_script_4 = CSharpScript()  # -> out, a
# ---------- c_script_4: C# ----------
// Grasshopper Script Instance
#region Usings
using System;
#r "D:\Architectural Templates\Ptarmigan\02_GH\_lib\Clipper2-main\Clipper2-main\Clipper2Lib.dll"
using System.Linq;
using System.Collections;
using System.Collections.Generic;
using System.Drawing;

using Rhino;
using Rhino.Geometry;

using Clipper2Lib;

using Grasshopper;
using Grasshopper.Kernel;
using Grasshopper.Kernel.Data;
using Grasshopper.Kernel.Types;
#endregion

public class Script_Instance : GH_ScriptInstance
{
    #region Notes
    /* 
      Members:
        RhinoDoc RhinoDocument
        GH_Document GrasshopperDocument
        IGH_Component Component
        int Iteration

      Methods (Virtual & overridable):
        Print(string text)
        Print(string format, params object[] args)
        Reflect(object obj)
        Reflect(object obj, string method_name)
    */
    #endregion

    private void RunScript(ref object a)
    {


        double scale = 1000.0;

        // 1. Build input shapes
        Path64 pattern = Clipper.Ellipse(new Point64(100, 100), 30, 30);
        Path64 path = Clipper.MakePath(new int[] { 0, 0, 200, 0, 200, 200, 0, 200, 0, 0 });

        // 2. Perform Minkowski sum
        Paths64 solution = Clipper.MinkowskiSum(pattern, path, true);

        // 3. Convert result to Rhino polylines
        List<PolylineCurve> curves = new List<PolylineCurve>();

        foreach (Path64 poly in solution)
        {
            Polyline rhinoPoly = new Polyline();

            foreach (Point64 pt in poly)
            {
                // De-scale for Rhino display
                double x = (double)pt.X / scale;
                double y = (double)pt.Y / scale;
                rhinoPoly.Add(new Point3d(x, y, 0));
            }

            // Close the polyline if necessary
            if (!rhinoPoly.IsClosed)
                rhinoPoly.Add(rhinoPoly[0]);

            curves.Add(new PolylineCurve(rhinoPoly));
        }

        // 4. Output to Grasshopper
        a = curves;

    }
}
# ---------- end c_script_4 ----------

# ----
c_script_5 = CSharpScript(pts=removeduplicatepts_2, radius=number_slider_3)  # -> out, a; inputs pts: list of Point3d, radius: Double
# ---------- c_script_5: C# ----------
// Grasshopper Script Instance
#region Usings
using System;
#r "D:\Architectural Templates\Ptarmigan\02_GH\_lib\Clipper2-main\Clipper2-main\Clipper2Lib.dll"
using System.Linq;
using System.Collections;
using System.Collections.Generic;
using System.Drawing;

using Rhino;
using Rhino.Geometry;

using Clipper2Lib;

using Grasshopper;
using Grasshopper.Kernel;
using Grasshopper.Kernel.Data;
using Grasshopper.Kernel.Types;
#endregion

public class Script_Instance : GH_ScriptInstance
{
    #region Notes
    /* 
      Members:
        RhinoDoc RhinoDocument
        GH_Document GrasshopperDocument
        IGH_Component Component
        int Iteration

      Methods (Virtual & overridable):
        Print(string text)
        Print(string format, params object[] args)
        Reflect(object obj)
        Reflect(object obj, string method_name)
    */
    #endregion

    private void RunScript(List<Point3d> pts, double radius, ref object a)
    {
        //Path points
        //Convert Point3d to PathD
        double scale = 1000;

        Path64 path = new Path64();

        foreach (Point3d pt in pts)
        {
            long x = (long)(pt.X*scale);
            long y = (long)(pt.Y*scale);
            path.Add(new Point64(x,y));
        }

        Path64 circle = new Path64();

        double seg = 64;
        for (int i=0; i<seg; i++)
        {
            double angle = 2*Math.PI*i/seg;
            double x = radius*Math.Cos(angle);
            double y = radius*Math.Sin(angle);

            long ix = (long)(x * scale);
            long iy = (long)(y * scale);

            circle.Add(new Point64(ix,iy));
        }

        Paths64 MinkSum = Clipper.MinkowskiSum(circle,path,true);

        List<Point3d> MinksPts = new List<Point3d>();
        
        foreach (Path64 offset in MinkSum)
        {
            foreach(Point64 pt in offset)
            {
                double x = pt.X/scale;
                double y = pt.Y/scale;
                double z = 0;

                MinksPts.Add(new Point3d(x,y,z));
            }

            a=MinksPts;

        }

        //Console.WriteLine(path);
        //Console.WriteLine(circle);
        //Console.WriteLine(MinksPts);
        Console.WriteLine(MinkSum);
        // Write your logic here
        //a = null;
    }
}
# ---------- end c_script_5 ----------
c_script_6 = CSharpScript(pts=removeduplicatepts, radius=range)  # -> out, a, b; inputs pts: list of Point3d, radius: Double
# ---------- c_script_6: C# ----------
// Grasshopper Script Instance
#region Usings
using System;
#r "D:\Architectural Templates\Ptarmigan\02_GH\_lib\Clipper2-main\Clipper2-main\Clipper2Lib.dll"
using System.Linq;
using System.Collections;
using System.Collections.Generic;
using System.Drawing;

using Rhino;
using Rhino.Geometry;

using Clipper2Lib;

using Grasshopper;
using Grasshopper.Kernel;
using Grasshopper.Kernel.Data;
using Grasshopper.Kernel.Types;
#endregion

public class Script_Instance : GH_ScriptInstance
{
    #region Notes
    /* 
      Members:
        RhinoDoc RhinoDocument
        GH_Document GrasshopperDocument
        IGH_Component Component
        int Iteration

      Methods (Virtual & overridable):
        Print(string text)
        Print(string format, params object[] args)
        Reflect(object obj)
        Reflect(object obj, string method_name)
    */
    #endregion

    private void RunScript(
		List<Point3d> pts,
		double radius,
		ref object a,
		ref object b)
    {
        //Path points
        //Convert Point3d to PathD
        double scale = 1000;

        Path64 path = new Path64();

        foreach (Point3d pt in pts)
        {
            long x = (long)(pt.X*scale);
            long y = (long)(pt.Y*scale);
            path.Add(new Point64(x,y));
        }

        Path64 circle = new Path64();

        double seg = 64;
        for (int i=0; i<seg; i++)
        {
            double angle = 2*Math.PI*i/seg;
            double x = radius*Math.Cos(angle);
            double y = radius*Math.Sin(angle);

            long ix = (long)(x * scale);
            long iy = (long)(y * scale);

            circle.Add(new Point64(ix,iy));
        }

        Paths64 MinkSum = Clipper.MinkowskiSum(circle,path,true);

        List<PolylineCurve> resultcrv = new List<PolylineCurve>();

        foreach (Path64 offset in MinkSum)
        {
            Polyline poly = new Polyline();
            foreach (Point64 pt in offset)
            {
                double x = pt.X/scale;
                double y = pt.Y/scale;
                double z = 0;
                poly.Add(new Point3d(x,y,z));

            }




            resultcrv.Add(new PolylineCurve(poly));

            
        }


        
        a=resultcrv;

        // Write your logic here
        //a = null;
    }
}
# ---------- end c_script_6 ----------
area = Area(Geometry=c_script_4.a)  # -> Area, Centroid
c_script_7 = CSharpScript(pts=removeduplicatepts_3, radius=range, type=Toggle(False))  # -> out, a, b; inputs pts: list of Point3d, radius: Double, type: Boolean
# ---------- c_script_7: C# ----------
// Grasshopper Script Instance
#region Usings
using System;
#r "D:\Architectural Templates\Ptarmigan\02_GH\_lib\Clipper2-main\Clipper2-main\Clipper2Lib.dll"
using System.Linq;
using System.Collections;
using System.Collections.Generic;
using System.Drawing;

using Rhino;
using Rhino.Geometry;

using Clipper2Lib;

using Grasshopper;
using Grasshopper.Kernel;
using Grasshopper.Kernel.Data;
using Grasshopper.Kernel.Types;
#endregion

public class Script_Instance : GH_ScriptInstance
{
    #region Notes
    /* 
      Members:
        RhinoDoc RhinoDocument
        GH_Document GrasshopperDocument
        IGH_Component Component
        int Iteration

      Methods (Virtual & overridable):
        Print(string text)
        Print(string format, params object[] args)
        Reflect(object obj)
        Reflect(object obj, string method_name)
    */
    #endregion

    private void RunScript(
		List<Point3d> pts,
		double radius,
		bool type,
		ref object a,
		ref object b)
    {
        //Path points
        //Convert Point3d to PathD
        double scale = 1000;

        Path64 path = new Path64();

        foreach (Point3d pt in pts)
        {
            long x = (long)(pt.X*scale);
            long y = (long)(pt.Y*scale);
            path.Add(new Point64(x,y));
        }

        Path64 circle = new Path64();

        double seg = 64;
        for (int i=0; i<seg; i++)
        {
            double angle = 2*Math.PI*i/seg;
            double x = radius*Math.Cos(angle);
            double y = radius*Math.Sin(angle);

            long ix = (long)(x * scale);
            long iy = (long)(y * scale);

            circle.Add(new Point64(ix,iy));
        }

        Paths64 MinkSum = Clipper.MinkowskiSum(circle,path,type);

        List<PolylineCurve> resultcrv = new List<PolylineCurve>();

        foreach (Path64 offset in MinkSum)
        {
            Polyline poly = new Polyline();
            foreach (Point64 pt in offset)
            {
                double x = pt.X/scale;
                double y = pt.Y/scale;
                double z = 0;
                poly.Add(new Point3d(x,y,z));

            }




            resultcrv.Add(new PolylineCurve(poly));

            
        }
        
        a=resultcrv;

        
        //put all segments in a polyline list
        List<PolylineCurve> plineseg = new List<PolylineCurve>(resultcrv);
        List<Polyline> allseg = new List<Polyline>();

        foreach (PolylineCurve ply in plineseg)
        {
            Polyline polyline = ply.ToPolyline();
            allseg.Add(polyline);
        }
        
        List<Point3d> allpts = new List<Point3d>();
        foreach (Polyline ply in allseg)
        {
            allpts.AddRange(ply);
        }

        

        b=allpts;
        // Write your logic here
        //a = null;

    }
}
# ---------- end c_script_7 ----------

# ---- group: Converting Points3d to PathD
c_script_8 = CSharpScript(pts=removeduplicatepts_2)  # -> out, a; inputs pts: list of Point3d
# ---------- c_script_8: C# ----------
// Grasshopper Script Instance
#region Usings
using System;
#r "D:\Architectural Templates\Ptarmigan\02_GH\_lib\Clipper2-main\Clipper2-main\Clipper2Lib.dll"
using System.Linq;
using System.Collections;
using System.Collections.Generic;
using System.Drawing;

using Rhino;
using Rhino.Geometry;

using Clipper2Lib;

using Grasshopper;
using Grasshopper.Kernel;
using Grasshopper.Kernel.Data;
using Grasshopper.Kernel.Types;
#endregion

public class Script_Instance : GH_ScriptInstance
{
    #region Notes
    /* 
      Members:
        RhinoDoc RhinoDocument
        GH_Document GrasshopperDocument
        IGH_Component Component
        int Iteration

      Methods (Virtual & overridable):
        Print(string text)
        Print(string format, params object[] args)
        Reflect(object obj)
        Reflect(object obj, string method_name)
    */
    #endregion

    private void RunScript(List<Point3d> pts, ref object a)
    {
        //convert Point3d to PathD
        PathD path = new PathD();
        foreach (Point3d pt in pts)
        {
            path.Add(new PointD(pt.X, pt.Y));
        }

        Console.WriteLine(path);

        //convert PathD to Point3d
        List<Point3d> rhinoPoints = new List<Point3d>();

        foreach (PointD pt in path)
        {
            rhinoPoints.Add(new Point3d(pt.x, pt.y, 0));
        }
        Console.WriteLine(rhinoPoints);

        a=rhinoPoints;
    }
}
# ---------- end c_script_8 ----------

# ----
curve_6 = Curve(c_script_7.a)
panel_2 = Panel(c_script_6.a)
scale = Scale(Geometry=c_script_4.a, Center=area.Centroid, Factor=Slider(10, range=0..10))  # -> Geometry, Transform
close_curve = CloseCurve(Curve=curve_6, CloseType=0, Bulge=0.5, Tolerance=0)  # -> Closed, ResultBoolean
# Paths64 MinkowskiSum(const Path64& pattern, const Path64& path, const isClosed);
# 
# 1. Convert points into Path64 (both pattern and the path)
# 2. Use Clipper.MinkowskiSum
# 3. Convert back into RhinoPoints
fillet_2 = Fillet(Curve=close_curve.Closed, Radius=number_slider_3)
