# Grasshopper definition Proximity by Mesh Pipe.gh (Grasshopper 1.0.8)
# plug-ins: RhinoCodePluginGH

dont_change = Slider(0, range=0..1)
proximity_radii = Slider(1.5, range=0..10)
curve = Curve([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])
c_script = CSharpScript(curves=curve, radius=proximity_radii, accuracy="10", capType=dont_change)  # -> out, a; inputs curves: list of Curve, radius: Double, accuracy: Int32, capType: Int32
# ---------- c_script: C# ----------
// Grasshopper Script Instance
#region Usings
using System;
using System.Linq;
using System.Collections;
using System.Collections.Generic;
using System.Drawing;

using Rhino;
using Rhino.Geometry;

using Grasshopper;
using Grasshopper.Kernel;
using Grasshopper.Kernel.Data;
using Grasshopper.Kernel.Types;
#endregion

public class Script_Instance : GH_ScriptInstance
{
    #region Notes
    /* 
      Members:
        RhinoDoc RhinoDocument
        GH_Document GrasshopperDocument
        IGH_Component Component
        int Iteration

      Methods (Virtual & overridable):
        Print(string text)
        Print(string format, params object[] args)
        Reflect(object obj)
        Reflect(object obj, string method_name)
    */
    #endregion

    private void RunScript(
	List<Curve> curves,
	double radius,
	int accuracy,
	int capType,
	ref object a)
    {
        // Correct
    var pipes = new List<Mesh>();
    var cap_style = (MeshPipeCapStyle) capType;
    
    // iterate over the curve *list*
    foreach (var curve in curves)
    {
        
      // Static methods requires starting the method call from the base class; "Mesh.<method>":
      var mesh_pipe = Rhino.Geometry.Mesh.CreateFromCurvePipe(curve, radius, 4, accuracy, cap_style, true);
      pipes.Add(mesh_pipe);
    }
    a = pipes;
    }
}
# ---------- end c_script ----------
collision_many_many = CollisionManyMany(Colliders=c_script.a)  # -> Collision, Indices
cull_pattern = CullPattern(List=c_script.a, CullPattern=collision_many_many.Collision)
